# Grasshopper definition definition.gh (Grasshopper 1.0.7)

# ---- group: Input Params
curvestartverticaloffset = Slider(10, range=0..10)
column_curve_length = Slider(166, range=125..175)
basiccurvelength = Slider(100, range=75..125)
basiccurveheight = Slider(100, range=0..100)
switch_mounting_hole_side_length = Panel("14.05")
row_curve_order = Panel("3")
column_curve_order = Panel("3")
max_columns = Panel("8")
max_rows = Panel("6")

# ----
rows = Slider(4, range=4..6)
columns = Slider(6, range=6..8)

# ---- group: Basic Row Curve / Series for Sampling Graph Mapper
expression = Expression(x=max_rows, Expression="x-1")
division = Division(A=1, B=expression)
series = Series(Start=0, Step=division, Count=max_rows)

# ---- group: Basic Column Curve / Series for Sampling Graph Mapper
expression_2 = Expression(x=max_columns, Expression="x-1")
division_2 = Division(A=1, B=expression_2)
series_2 = Series(Start=0, Step=division_2, Count=max_columns)

# ---- group: Basic Row Curve
graph = GraphMapper(
    series,
    x0=0,
    x1=1,
    y0=0,
    y1=1,
    container_name="Bezier",
    cpx=[0, 0.4178820848, 0.6511453986, 1],
    cpy=[0.3220852017, 0.2439115047, 0.3942021728, 0.4764174223])

# ---- group: Basic Column Curve
graph_2 = GraphMapper(
    series_2,
    x0=0,
    x1=1,
    y0=0,
    y1=1,
    container_name="Bezier",
    cpx=[0, 0.3337826431, 0.6389575005, 1],
    cpy=[0.4918646216, 0.3852787018, 0.6093820333, 0.623046875])

# ---- group: Basic Row Curve / Determine Row Curve Geometry
multiplication = Multiplication(A=graph, B=basiccurveheight)
item = ListItem(List=multiplication, Index=0, Wrap=True)
expression_3 = Expression(x=multiplication, y=item, z=curvestartverticaloffset, Expression="x-y+z")
multiplication_2 = Multiplication(A=series, B=basiccurvelength)
pt = ConstructPoint(XCoordinate=0, YCoordinate=multiplication_2, ZCoordinate=expression_3)
series_3 = Series(Start=0, Step=1, Count=rows)
item_2 = ListItem(List=pt, Index=series_3, Wrap=True)
intcrv = Interpolate(Vertices=pt, Degree=row_curve_order, Periodic=False, KnotStyle=1)  # -> Curve, Length, Domain

# ---- group: Basic Column Curve / Determine Column Curve Geometry
multiplication_3 = Multiplication(A=graph_2, B=basiccurveheight)
item_3 = ListItem(List=multiplication_3, Index=0, Wrap=True)
expression_4 = Expression(x=multiplication_3, y=item_3, z=curvestartverticaloffset, Expression="x-y+z")
multiplication_4 = Multiplication(A=series_2, B=column_curve_length)
pt_2 = ConstructPoint(XCoordinate=multiplication_4, YCoordinate=0, ZCoordinate=expression_4)
series_4 = Series(Start=0, Step=1, Count=columns)
item_4 = ListItem(List=pt_2, Index=series_4, Wrap=True)
intcrv_2 = Interpolate(Vertices=pt_2, Degree=column_curve_order, Periodic=False, KnotStyle=1)  # -> Curve, Length, Domain

# ----
panel = Panel(item_4)
panel_2 = Panel(item_2)

# ---- group: Curve Grid Geometry
subtraction = Subtraction(A=expression_3, B=curvestartverticaloffset)
subtraction_2 = Subtraction(A=expression_4, B=curvestartverticaloffset)
addition = Addition(A=expression_4, B=simplify(graft(subtraction)))
addition_2 = Addition(A=expression_3, B=simplify(graft(subtraction_2)))
pt_3 = ConstructPoint(XCoordinate=multiplication_4, YCoordinate=simplify(graft(multiplication_2)), ZCoordinate=addition)  # -> simplify(Point)
pt_4 = ConstructPoint(XCoordinate=simplify(graft(multiplication_4)), YCoordinate=multiplication_2, ZCoordinate=addition_2)  # -> simplify(Point)
intcrv_3 = Interpolate(Vertices=pt_4, Degree=row_curve_order, Periodic=False, KnotStyle=1)  # -> Curve, Length, Domain
intcrv_4 = Interpolate(Vertices=pt_3, Degree=column_curve_order, Periodic=False, KnotStyle=1)  # -> Curve, Length, Domain

# ---- group: Mounting Surface
mounting_surface_offset = Panel("15")
mounting_surface_thickness = Panel("3")
netsurf = NetworkSurface(CurvesU=flatten(intcrv_3.Curve), CurvesV=flatten(intcrv_4.Curve), Continuity=2)
offset = OffsetSurface(Surface=netsurf, Distance=mounting_surface_offset, Retrim=True)
offset_2 = OffsetSurface(Surface=offset, Distance=mounting_surface_thickness, Retrim=True)
loft = Loft(
    Curves=[offset, offset_2],
    Options={Adjust=False, Closed=False, LoftEnds=0, LoftSimp=0, LoftType=0, Rebuild=10, Refit=0.01})
bvol = BoundaryVolume(Boundaries=[offset, offset_2, loft])
preview = CustomPreview(
    Geometry=bvol,
    Material={diffuse=RGB(221, 160, 221), emission=RGB(66, 48, 66), shine=0.5, specular=RGB(255, 255, 255), transparency=0})

# ---- group: Typing Surface Normals / Determine column curve normals
pt_5 = ConstructPoint(XCoordinate=multiplication_4, YCoordinate=0, ZCoordinate=0)
yz = YZPlane(Origin=pt_5)
pcx = CurvePlane(Curve=intcrv_2.Curve, Plane=yz)  # -> Points, flatten(ParamsC), ParamsP
eval = EvaluateCurve(Curve=intcrv_2.Curve, Parameter=pcx.ParamsC)  # -> Point, Tangent, Angle
Y = UnitY(Factor=1)

# ---- group: Typing Surface Normals / Determine column curve normals / Clean up x-value
devec = DeconstructVector(Vector=eval.Tangent)  # -> XComponent, YComponent, ZComponent
vec = VectorXYZ(XComponent=1, YComponent=devec.YComponent, ZComponent=devec.ZComponent)  # -> Vector, Length

# ---- group: Typing Surface Normals / Determine column curve normals (continued)
amp = Amplitude(Vector=vec.Vector, Amplitude=1)
pl = ConstructPlane(Origin=eval.Point, XAxis=amp, YAxis=Y)

# ---- group: Typing Surface Normals / Determine row curve normals
pt_6 = ConstructPoint(XCoordinate=0, YCoordinate=multiplication_2, ZCoordinate=0)
xz = XZPlane(Origin=pt_6)
pcx_2 = CurvePlane(Curve=intcrv.Curve, Plane=xz)  # -> Points, flatten(ParamsC), ParamsP
eval_2 = EvaluateCurve(Curve=intcrv.Curve, Parameter=pcx_2.ParamsC)  # -> Point, Tangent, Angle
X = UnitX(Factor=1)

# ---- group: Typing Surface Normals / Determine row curve normals / Clean up y-value
devec_2 = DeconstructVector(Vector=eval_2.Tangent)  # -> XComponent, YComponent, ZComponent
vec_2 = VectorXYZ(XComponent=devec_2.XComponent, YComponent=1, ZComponent=devec_2.ZComponent)  # -> Vector, Length

# ---- group: Typing Surface Normals / Determine row curve normals (continued)
amp_2 = Amplitude(Vector=vec_2.Vector, Amplitude=1)
pl_2 = ConstructPlane(Origin=eval_2.Point, XAxis=X, YAxis=amp_2)

# ---- group: Typing Surface Normals / Get surface normals by pythagorean combination of curve normals
vec_3 = Vector(pl_2)
vec_4 = Vector(pl)
devec_3 = DeconstructVector(Vector=vec_4)  # -> XComponent, YComponent, ZComponent
devec_4 = DeconstructVector(Vector=vec_3)  # -> XComponent, YComponent, ZComponent
expression_5 = Expression(x=simplify(graft(devec_3.XComponent)), y=devec_4.YComponent, Expression="sqrt(1-x^2-y^2)")
vec_5 = VectorXYZ(XComponent=simplify(graft(devec_3.XComponent)), YComponent=devec_4.YComponent, ZComponent=expression_5)  # -> simplify(Vector), Length

# ---- group: Remove Keyswitch Cutout from Mounting Surface
mounting_pole_cut_tolerance = Panel("5")  # disabled
addition_3 = Addition(A=mounting_surface_offset, B=mounting_surface_thickness)  # disabled
vec_6 = Vector(vec_5.Vector)  # disabled
pt_7 = Point(pt_4)  # disabled
xy = XYPlane(Origin=Point(0, 0, 0))  # disabled
expression_6 = Expression(x=switch_mounting_hole_side_length, Expression="x/sqrt(2)")  # disabled
rev = Reverse(Vector=vec_6)  # disabled
addition_4 = Addition(A=addition_3, B=mounting_pole_cut_tolerance)  # disabled
multiplication_5 = Multiplication(A=rev, B=addition_4)  # disabled
addition_5 = Addition(A=pt_7, B=multiplication_5)  # disabled
polygon = Polygon(Plane=xy, Radius=expression_6, Segments=4, FilletRadius=0)  # -> Polygon, Length; disabled
brep = Brep(bvol)  # disabled
pl_3 = PlaneNormal(Origin=pt_7, ZAxis=vec_6)  # disabled
ln = Line(StartPoint=pt_7, EndPoint=addition_5)  # disabled
rotate = Rotate(Geometry=polygon.Polygon, Angle=0.7853981634, Plane=PlaneXY(0, 0, 0))  # -> Geometry, Transform; disabled
extrude = ExtrudeLinear(Profile=rotate.Geometry, OrientationP=xy, Axis=ln, OrientationA=pl_3)  # disabled
cap = CapHoles(Brep=extrude)  # disabled
sdiff = SolidDifference(BrepsA=brep, BrepsB=flatten(cap))  # disabled
preview_2 = CustomPreview(
    Geometry=sdiff,
    Material={diffuse=RGB(221, 160, 221), emission=RGB(66, 48, 66), shine=0.5, specular=RGB(255, 255, 255), transparency=0})  # disabled

# ---- group: Generate Keycaps
srf = Surface([<surface referenced from the Rhino model> x34])  # disabled
join = BrepJoin(Breps=srf)  # -> Breps, Closed; disabled
Z = UnitZ(Factor=1)  # disabled
rotate_2 = RotateDirection(Geometry=join.Breps, Center=Point(0, 0, 0), From=Z, To=vec_5.Vector)  # -> Geometry, Transform; disabled
move = Move(Geometry=rotate_2.Geometry, Motion=pt_4)  # -> Geometry, Transform; disabled
preview_3 = CustomPreview(
    Geometry=move.Geometry,
    Material={diffuse=RGB(221, 160, 221), emission=RGB(66, 48, 66), shine=0.5, specular=RGB(255, 255, 255), transparency=0})  # disabled
